# Dynamo graph Create_alignment.dyn (Dynamo 2.5.2.7915)
# packages: Civil3DToolkit 1.1.30

name = StringInput("")  # graph input
seq_id = DoubleInput(0)  # graph input
data1 = CodeBlock { 100; 1; }
sequence = Sequence(start=seq_id, amount=data1.out0, step=data1.out1)
# note: ~ SCRIPT CREADO POR  ANDRÉS G.  RODRÍGUEZ ~
add = name + sequence
select_polylines = ObjectsSelection()  # 1 picked in the model; graph input
code_block = CodeBlock { "HP-ALIGN-DESING"; }
style = StringInput("ACM_DISEÑO")
label = StringInput("_No Labels")
boolean = BoolSelector(false)
createAlignmentByPolyline = Autodesk.Civil.DynamoNodes.AlignmentExtensions.CreateAlignmentByPolyline(name=add, polyline=select_polylines, layer=code_block, style=style, labelSet=label, addCurves=boolean)
