# Dynamo graph PROFILE4.dyn (Dynamo 2.5.2.7915)
# packages: Civil3DToolkit 1.1.28, Civil3DToolkit 1.1.30

# group: Multiples
current = Autodesk.AutoCAD.DynamoNodes.Document.Current()
surfaces = Surfaces(document=current)
alignments = Alignments(document=current)

pick_point = PickPoint()  # 1 picked in the model
string_from_object = FromObject(obj=alignments)
BANDSTYLE = StringInput("RGT_BAND_ENG_ESP")
STYLE = StringInput("RGT_AE_EAAB")
byAlignmentPointName = Autodesk.Civil.DynamoNodes.ProfileView.ByAlignmentPointName(alignment=alignments, insertPoint=pick_point, profileViewName=string_from_object, bandSet=BANDSTYLE, style=STYLE)
string = StringInput("_No Labels")
number = DoubleInput(1)
startStation = Autodesk.Civil.DynamoNodes.Alignment.StartStation(alignment=alignments)
endStation = Autodesk.Civil.DynamoNodes.Alignment.EndStation(alignment=alignments)
string_2 = StringInput("0")

# group: PROYECTADO
string_3 = StringInput("Union Superficie V3")
string_4 = StringInput("ACM_PROYECTADO")
addProfileBySurface = Autodesk.Civil.DynamoNodes.AlignmentExtensions.AddProfileBySurface(alignment=alignments, profileName=string_3, surface=string_3, style=string_4, labelSet=string, offset=number, sampleStart=startStation, sampleEnd=endStation, layer=string_2)

# group: EG
string_5 = StringInput("EG")
string_6 = StringInput("Terreno Existente")
addProfileBySurface_2 = Autodesk.Civil.DynamoNodes.AlignmentExtensions.AddProfileBySurface(alignment=alignments, profileName=string_5, surface=string_5, style=string_6, labelSet=string, offset=number, sampleStart=startStation, sampleEnd=endStation, layer=string_2)

# group: Específico
select_objects = ObjectsSelection()  # 1 picked in the model
