# Dynamo graph SUB_PROFILE.dyn (Dynamo 2.5.2.7915)
# packages: Civil3DToolkit 1.1.28, Civil3DToolkit 1.1.30

alignments = AlignmentNamesDropDown("RM13")
string_from_object = FromObject(obj=alignments)
string = StringInput("Design Profile")
addProfileByName = Autodesk.Civil.DynamoNodes.AlignmentExtensions.AddProfileByName(alignment=alignments, profileName=string_from_object, style=string)
watch = Watch(alignments)
startStation = Autodesk.Civil.DynamoNodes.Alignment.StartStation(alignment=watch)
number = DoubleInput(23.09)
addPVI = Autodesk.Civil.DynamoNodes.ProfileExtensions.AddPVI(profile=addProfileByName, station=startStation, elevation=number)
endStation = Autodesk.Civil.DynamoNodes.Alignment.EndStation(alignment=watch)
number_2 = DoubleInput(23.09)
addPVI_2 = Autodesk.Civil.DynamoNodes.ProfileExtensions.AddPVI(profile=addPVI.Profile, station=endStation, elevation=number_2)
